test file "tests"

suite "Tests"

  case "Activate brakes when signalled." [baseline]
    model Model, harness Model_Harness1 (for Model/T-SUB)
    input "BrakePedal.mat", mapped to Accelerator Pedal (CAN), Brake Pedal (CAN), Mode Switch (CAN), Accelerometer, Velocity (CAN), Lamp Monitor (active)
    logged signals "Signal Set 1": Output Conversion Subsystem:1, Output Conversion Subsystem:2, Output Conversion Subsystem:3
    assessment "ActivateBrakes": At any point of time, whenever brake_sig > 0 is true then, with a delay of at most 0.05, lamp_status == true must be true
    assessment "OnePedalMode": At any point of time, whenever accel_pedal < 26214 & pedal_mode == 1 is true then, with a delay of at most 0.05, lamp_status == true must be true
    assessment "AccelerometerVelocityCheck": At any point of time, whenever accel >= 1.3 & velocity > 1.3 is true then, with a delay of at most 0.05, lamp_status == true must be true
    assessment "BrakesOff": At any point of time, whenever lamp_status == true & monitor == false is true then, with a delay of at most 0.05, warning_off == true must be true
    assessment "BrakesOn": At any point of time, whenever lamp_status == false & monitor == true is true then, with a delay of at most 0.05, warning_on == true must be true
      brake_sig: signal Model_Harness1/Brake Pedal (CAN), port 1
      accel_pedal: signal Model_Harness1/Accelerator Pedal (CAN), port 1
      pedal_mode: signal Model_Harness1/Mode Switch (CAN), port 1
      accel: signal Model_Harness1/Accelerometer, port 1
      velocity: signal Model_Harness1/T-SUB/Derivative, port 1
      monitor: signal Model_Harness1/Lamp Monitor, port 1
      lamp_status: signal Model_Harness1/Output Conversion Subsystem, port 1
      warning_off: signal Model_Harness1/Output Conversion Subsystem, port 3
      warning_on: signal Model_Harness1/Output Conversion Subsystem, port 2